# Grasshopper definition Cantilever.gh (Grasshopper 1.0.8)
# plug-ins: Bifocals, FEMur

number_slider = Slider(1000, range=0..1000)
number_slider_2 = Slider(4, range=0..10)
subtraction = Subtraction(A=number_slider_2, B=1)
division = Division(A=number_slider, B=subtraction)
unit_x = UnitX(Factor=division)
point = Point(Point(0, 0, 0))
panel = Panel("0.00014864096495526588")
linear_array = LinearArray(Geometry=point, Direction=unit_x, Count=number_slider_2)  # -> Geometry, Transform
polyline = PolyLine(Vertices=linear_array.Geometry, Closed=False)
number_slider_3 = Slider(1, range=0..10000)
expression = Expression(E=Slider(210000, range=0..1000000), I="10678762", P=number_slider_3, L=number_slider, Expression="P•L³/3/E/I")
panel_2 = Panel(expression)
node_femur = NodeFEMur(Points=linear_array.Geometry)
subtraction_2 = Subtraction(A=number_slider_2, B="1")
crosssection_h_femur = CrossSectionHFEMur(
    Id=0,
    Name="H-Section",
    B=Slider(200, range=0..1000),
    H=Slider(100, range=0..100),
    T_f=Slider(8, range=0..10),
    T_w=Slider(12, range=0..100),
    R=Slider(6, range=0..10))
material_femur = MaterialFEMur(Id=0)
split_list = SplitList(List=node_femur, Index=subtraction_2)  # -> ListA, ListB
split_list_2 = SplitList(List=node_femur, Index=Slider(1, range=0..1))  # -> ListA, ListB
unit_y = UnitY(Factor=number_slider_3)
unit_z = UnitZ(Factor=number_slider_3)
boolean_toggle = BooleanToggle(True)
panel_3 = Panel(material_femur)
panel_4 = Panel(crosssection_h_femur)
beamelement_femur = BeamElementFEMur(INodes=split_list.ListA, JNodes=split_list_2.ListB, Material=material_femur, CrossSection=crosssection_h_femur)
pointload_femur = PointLoadFEMur(Nodes=split_list.ListB, Force=unit_y, Moment=Vector(0, 0, 0), IsLocal=False)
pointload_femur_2 = PointLoadFEMur(Nodes=split_list.ListB, Force=unit_z, Moment=Vector(0, 0, 0), IsLocal=False)
support_femur = SupportFEMur(
    Nodes=split_list_2.ListA,
    UX=boolean_toggle,
    UY=boolean_toggle,
    UZ=boolean_toggle,
    RX=boolean_toggle,
    RY=boolean_toggle,
    RZ=boolean_toggle)
merge = Merge(Data1=pointload_femur_2, Data2=pointload_femur)
panel_5 = Panel(beamelement_femur)
assemblemodel_femur = AssembleModelFEMur(Nodes=node_femur, Elements=beamelement_femur, Supports=support_femur, Loads=merge)
linearstaticsolver_femur = LinearStaticSolverFEMur(Model=assemblemodel_femur, Run=True)  # -> AnalyzedModel, Info, Warnings
resultview_femur = ResultViewFEMur(AnalyzedModel=linearstaticsolver_femur.AnalyzedModel, Scale=Slider(380, range=0..1000))  # -> DeformedModel, DeformedNodes
deconstructresult_femur = DeconstructResultFEMur(AnalyzedModel=linearstaticsolver_femur.AnalyzedModel)  # -> NodalDisplacements, ElementStresses, DisplacementValues, StressInfo
sectionforceview_femur = SectionForceViewFEMur(AnalyzedModel=linearstaticsolver_femur.AnalyzedModel, Scale=Slider(0.92, range=0..1))
panel_6 = Panel(deconstructresult_femur.ElementStresses)
