# Grasshopper definition Ramen+.gh (Grasshopper 1.0.8)
# plug-ins: Bifocals, FEMur

number_slider = Slider(500, range=0..1000)
number_slider_2 = Slider(1000, range=0..1000)
unit_z = UnitZ(Factor=number_slider)
point = Point(Point(0, 0, 0))
unit_y = UnitY(Factor=number_slider_2)
move = Move(Geometry=point, Motion=unit_z)  # -> Geometry, Transform
unit_x = UnitX(Factor=number_slider_2)
move_2 = Move(Geometry=[point, move.Geometry], Motion=unit_x)  # -> Geometry, Transform
construct_domain = ConstructDomain(DomainStart=Slider(1, range=0..1), DomainEnd=Slider(2, range=0..10))
move_3 = Move(Geometry=move.Geometry, Motion=unit_y)  # -> Geometry, Transform
split_list = SplitList(List=move_2.Geometry, Index=Slider(1, range=0..1))  # -> ListA, ListB
merge = Merge(Data1=move.Geometry, Data2=move_3.Geometry)
number_slider_3 = Slider(0.0001, range=0..0.0001)
merge_2 = Merge(Data1=point, Data2=move.Geometry, Data3=split_list.ListB, Data4=split_list.ListA)  # -> flatten(Result)
move_4 = Move(Geometry=merge_2, Motion=unit_y)  # -> Geometry, Transform
line = Line(StartPoint=merge_2, EndPoint=move_4.Geometry)
polyline = PolyLine(Vertices=move_4.Geometry, Closed=False)
sub_list = SubList(List=line, Domain=construct_domain, Wrap=True)  # -> List, Index
polyline_2 = PolyLine(Vertices=merge_2, Closed=False)
number_slider_4 = Slider(7, range=0..10)
linear_array = LinearArray(Geometry=merge, Direction=unit_z, Count=number_slider_4)  # -> flatten(Geometry), Transform
merge_3 = Merge(Data1=polyline_2, Data2=polyline, Data3=sub_list.List)  # -> flatten(Result)
linear_array_2 = LinearArray(Geometry=merge_3, Direction=unit_z, Count=number_slider_4)  # -> flatten(Geometry), Transform
crosssection_circle_femur = CrossSectionCircleFEMur(D=100, T=0)
material_femur = MaterialFEMur(Preset=1)
crosssection_h_femur = CrossSectionHFEMur(
    H=Slider(200, range=0..1000),
    B=Slider(100, range=0..200),
    T_w=Slider(5.5, range=0..10),
    T_f=Slider(8, range=0..10),
    R=Slider(8, range=0..10))
boolean_toggle = BooleanToggle(True)
panel = Panel(material_femur)
beamelement = BeamElement(Polylines=linear_array_2.Geometry, Material=material_femur, CrossSection=crosssection_h_femur, BetaAngle=0)  # -> BeamElements, Points
deconstruct = Deconstruct(Point=flatten(beamelement.Points))  # -> XComponent, YComponent, ZComponent
deconstruct_2 = Deconstruct(Point=beamelement.Points)  # -> XComponent, YComponent, ZComponent
equality = Equality(FirstNumber=deconstruct.ZComponent, SecondNumber=number_slider)  # -> Equality, Inequality
smaller_than = SmallerThan(FirstNumber=deconstruct_2.ZComponent, SecondNumber=Slider(0.0001, range=0..0.0001))  # -> SmallerThan, OrEqualTo
cull_pattern = CullPattern(List=flatten(beamelement.Points), CullPattern=equality.Equality)  # -> flatten(List)
cull_pattern_2 = CullPattern(List=beamelement.Points, CullPattern=smaller_than.SmallerThan)
cull_duplicates = CullDuplicates(Points=cull_pattern, Tolerance=0.1, CullMode=3)  # -> Points, Indices, Valence
cull_duplicates_2 = CullDuplicates(Points=beamelement.Points, Tolerance=0.1, CullMode=3)  # -> Points, Indices, Valence
deconstruct_3 = Deconstruct(Point=cull_duplicates_2.Points)  # -> XComponent, YComponent, ZComponent
unit_x_2 = UnitX(Factor=deconstruct_3.ZComponent)
unit_y_2 = UnitY(Factor=deconstruct_3.ZComponent)
panel_2 = Panel(deconstruct_3.ZComponent)
pointload_femur = PointLoadFEMur(Points=flatten(cull_duplicates_2.Points), Force=flatten(unit_y_2), Moment=flatten(Vector(0, 0, 0)))  # -> flatten(PointLoads)
pointload_femur_2 = PointLoadFEMur(Points=flatten(cull_duplicates_2.Points), Force=flatten(unit_x_2), Moment=flatten(Vector(0, 0, 0)))  # -> flatten(PointLoads)
support_femur = SupportFEMur(Points=cull_pattern_2, RX=True, RY=True, RZ=True, UX=True, UY=True, UZ=True)  # -> flatten(Supports)
panel_3 = Panel(crosssection_h_femur)
assemblemodel_femur = AssembleModelFEMur(
    Elements=beamelement.BeamElements,
    Supports=support_femur,
    Loads=[pointload_femur, pointload_femur_2],
    IsDisplayTabExpanded=True,
    LocalAxisScale=0.3,
    SelectedForceUnit=1,
    SelectedLengthUnit=1,
    ShowCrossSection=False,
    ShowElementId=False,
    ShowLoad=True,
    ShowLocalAxis=False,
    ShowNodeId=False,
    ShowSupport=True)
linearstaticsolver_femur = LinearStaticSolverFEMur(Model=assemblemodel_femur, Run=Toggle(True))  # -> AnalyzedModel, Info, Warnings
panel_4 = Panel(linearstaticsolver_femur.Info)
deformationview_femur = DeformationViewFEMur(
    AnalyzedModel=linearstaticsolver_femur.AnalyzedModel,
    Scale=1,
    IsDisplayTabExpanded=True,
    SelectedDirection=6,
    ShowLegend=True,
    ShowNumbers=True)  # -> AnalyzedModel, DeformedModel
sectionforceview_femur = SectionForceViewFEMur(
    AnalyzedModel=deformationview_femur.AnalyzedModel,
    Scale=1,
    IsSectionForcesTabExpanded=True,
    SelectedForceType=5,
    SelectedForceUnit=1,
    SelectedLengthUnit=1,
    ShowFilled=True,
    ShowLegend=True,
    ShowNumbers=True)
reactionforceview_femur = ReactionForceViewFEMur(
    AnalyzedModel=sectionforceview_femur,
    Scale=1,
    IsReactionsTabExpanded=True,
    SelectedForceUnit=1,
    SelectedLengthUnit=1,
    ShowFx=True,
    ShowFy=True,
    ShowFz=True,
    ShowMx=True,
    ShowMy=True,
    ShowMz=True)
