# Grasshopper definition Ramen.gh (Grasshopper 1.0.8)
# plug-ins: Karamba3D, FEMur

unit_z = UnitZ(Factor=Slider(1000, range=0..1000))
point = Point(Point(0, 0, 0))
move = Move(Geometry=point, Motion=unit_z)  # -> Geometry, Transform
unit_x = UnitX(Factor=Slider(1000, range=0..1000))
move_2 = Move(Geometry=[point, move.Geometry], Motion=unit_x)  # -> Geometry, Transform
material_selection_karamba3d = MatSelect(menu=[dropdown(3), dropdown(1), dropdown(1)])
unit_x_2 = UnitX(Factor=Slider(1500, range=0..10000))
split_list = SplitList(List=move_2.Geometry, Index=Slider(1, range=0..1))  # -> ListA, ListB
move_3 = Move(Geometry=[split_list.ListA, point], Motion=unit_x_2)  # -> flatten(Geometry), Transform
move_4 = Move(Geometry=[split_list.ListB, move.Geometry], Motion=unit_x_2)  # -> flatten(Geometry), Transform
number_slider = Slider(100, range=0..100)
number_slider_2 = Slider(9, range=0..10)
support_karamba3d = Supp(PosInd=move_3.Geometry, Ct_kN_m=Vector(0, 0, 0), Cr_kNm_rad=Vector(0, 0, 0), menu=[buttons(on, on, on, on, on, on)])  # -> flatten(Support)
merge = Merge(Data1=point, Data2=move.Geometry, Data3=split_list.ListB, Data4=split_list.ListA)  # -> flatten(Result)
cross_section_karamba3d = CroSec(
    FamilyNameOfCrossSection="DefaultCroSec",
    Material=material_selection_karamba3d,
    Diameter_mm=number_slider,
    WallThickness_mm=number_slider_2,
    mode="Circular Hollow")
crosssection_circle_femur = CrossSectionCircleFEMur(D=number_slider, T=number_slider_2)
polyline = PolyLine(Vertices=merge, Closed=False)
move_5 = Move(Geometry=polyline, Motion=unit_x_2)  # -> Geometry, Transform
create_linear_element_karamba3d = LineElem(
    Line=move_5.Geometry,
    CrossSection=cross_section_karamba3d,
    LimitDistance_m=0.005,
    BucklingLengthY_m=-1,
    BucklingLengthZ_m=-1,
    BucklingLengthLT_m=-1,
    Bending=True,
    ToPolylineMaxAngle=0.25,
    ToPolylineTolerance=0.1,
    ToPolylineMaxEdgeLength=0.25,
    New=True,
    Remove=True,
    mode="LineToBeam",
    GuidGeneratorSeed=383206876)  # -> Element, Points, Info
material_femur = MaterialFEMur(Preset=1)
unit_x_3 = UnitX(Factor=Slider(5000, range=0..5000))
loads_karamba3d = Loads(ForceVector=unit_x_3, Local=False, PosInd=move_4.Geometry, LCase="LC0", mode="Point")  # -> flatten(Load)
pointload_femur = PointLoadFEMur(Points=flatten([split_list.ListB, move.Geometry]), Force=unit_x_3, Moment=Vector(0, 0, 0))
beamelement = BeamElement(Polylines=polyline, Material=material_femur, CrossSection=crosssection_circle_femur, BetaAngle=0)  # -> BeamElements, Points
support_femur = SupportFEMur(Points=flatten([split_list.ListA, point]), RX=True, RY=True, RZ=True, UX=True, UY=True, UZ=True)
assemble_model_karamba3d = Assemble(Elem=create_linear_element_karamba3d.Element, Support=support_karamba3d, Load=loads_karamba3d, LimitDistance_mm=0.005)  # -> Model, Info, Mass_kg, CentreOfGravity, LoadCaseNames
assemblemodel_femur = AssembleModelFEMur(
    Elements=beamelement.BeamElements,
    Supports=support_femur,
    Loads=pointload_femur,
    IsDisplayTabExpanded=True,
    LocalAxisScale=0.3,
    ShowCrossSection=False,
    ShowElementId=False,
    ShowLoad=False,
    ShowLocalAxis=False,
    ShowNodeId=False,
    ShowSupport=True)
model_view_karamba3d = ModelView(Model=assemble_model_karamba3d.Model)  # -> Model, DeformedMesh, DeformedAxes, DeformedModel, MaximumDeformation
linearstaticsolver_femur = LinearStaticSolverFEMur(Model=assemblemodel_femur, Run=True)  # -> AnalyzedModel, Info, Warnings
deconstructresult_femur = DeconstructResultFEMur(AnalyzedModel=linearstaticsolver_femur.AnalyzedModel)  # -> NodalDisplacements, ElementStresses, DisplacementValues, StressInfo
analyse_karamba3d = Analyse(Model=assemble_model_karamba3d.Model)  # -> AnalysedModel, MaximumDisplacement_mm, ResultingForce_N, ChangeOfElasticEnergy_kNm
deformationview_femur = DeformationViewFEMur(
    AnalyzedModel=linearstaticsolver_femur.AnalyzedModel,
    Scale=Slider(2, range=0..100),
    IsDisplayTabExpanded=False,
    SelectedDirection=6,
    ShowLegend=True,
    ShowNumbers=True)
sectionforceview_femur = SectionForceViewFEMur(
    AnalyzedModel=linearstaticsolver_femur.AnalyzedModel,
    Scale=1,
    IsSectionForcesTabExpanded=True,
    SelectedForceType=5,
    SelectedForceUnit=1,
    SelectedLengthUnit=1,
    ShowFilled=True,
    ShowLegend=True,
    ShowNumbers=True)
line = Line(deformationview_femur)
panel = Panel(deconstructresult_femur.ElementStresses)
beam_view_karamba3d = BeamView(Model=analyse_karamba3d.AnalysedModel)  # -> Model, MeshesOfRenderedBeams, DeformedBeamAxes, LegendColours, LegendTags
mesh = Mesh(beam_view_karamba3d.MeshesOfRenderedBeams)
deconstruct_mesh = DeconstructMesh(Mesh=mesh)  # -> Vertices, Faces, Colours, Normals
list_item = ListItem(List=deconstruct_mesh.Faces, Index=Slider(7, range=0..20), Wrap=True)
