# Grasshopper definition Truss.gh (Grasshopper 1.0.8)
# plug-ins: FEMur

unit_x = UnitX(Factor=1)
point = Point(Point(0, 0, 0))
line_sdl = LineSDL(Start=point, Direction=unit_x, Length=Slider(7000, range=0..10000))
divide_curve = DivideCurve(Curve=line_sdl, Count=Slider(10, range=0..10), Kinks=False)  # -> Points, Tangents, Parameters
unit_z = UnitZ(Factor=Slider(800, range=0..1000))
move = Move(Geometry=divide_curve.Points, Motion=unit_z)  # -> Geometry, Transform
line = Line(StartPoint=divide_curve.Points, EndPoint=move.Geometry)  # -> flatten(Line)
polyline = PolyLine(Vertices=divide_curve.Points, Closed=False)  # -> flatten(Polyline)
polyline_2 = PolyLine(Vertices=move.Geometry, Closed=False)  # -> flatten(Polyline)
material_femur = MaterialFEMur(Id=0)
crosssection_h_femur = CrossSectionHFEMur(
    Id=0,
    Name="H-Section",
    B=Slider(100, range=0..1000),
    H=Slider(100, range=0..100),
    T_f=Slider(8, range=0..10),
    T_w=Slider(12, range=0..100),
    R=Slider(6, range=0..10))
crosssection_h_femur_2 = CrossSectionHFEMur(
    Id=0,
    Name="H-Section",
    B=Slider(100, range=0..1000),
    H=Slider(100, range=0..100),
    T_f=Slider(8, range=0..10),
    T_w=Slider(12, range=0..100),
    R=Slider(6, range=0..10))
crosssection_h_femur_3 = CrossSectionHFEMur(
    Id=0,
    Name="H-Section",
    B=Slider(100, range=0..1000),
    H=Slider(100, range=0..100),
    T_f=Slider(8, range=0..10),
    T_w=Slider(12, range=0..100),
    R=Slider(6, range=0..10))
linetobeam = LineToBeam(
    Lines=line,
    Material=material_femur,
    CrossSection=crosssection_h_femur_3,
    Tolerance=0.001,
    RemoveDuplicates=True,
    BetaAngle=0)  # -> Nodes, Elements, Info
linetobeam_2 = LineToBeam(
    Lines=polyline,
    Material=material_femur,
    CrossSection=crosssection_h_femur,
    Tolerance=0.001,
    RemoveDuplicates=True,
    BetaAngle=0)  # -> Nodes, Elements, Info
linetobeam_3 = LineToBeam(
    Lines=polyline_2,
    Material=material_femur,
    CrossSection=crosssection_h_femur_2,
    Tolerance=0.001,
    RemoveDuplicates=True,
    BetaAngle=0)  # -> Nodes, Elements, Info
merge = Merge(Data1=linetobeam_2.Nodes, Data2=linetobeam.Nodes, Data3=linetobeam_3.Nodes)
merge_2 = Merge(Data1=linetobeam_2.Elements, Data2=linetobeam.Elements, Data3=linetobeam_3.Elements)
assemblemodel_femur = AssembleModelFEMur(Nodes=merge, Elements=merge_2)
